% Simulink data dictionary pet_integration_data_dictionary.sldd

argin_import_pet = Simulink.Bus()
  iSubject: int16, Min=0
  MriFile: string
  FileFormat: string
  isInteractive: boolean
  isAutoAdjust: boolean
  Comment: string
  Labels: Bus: Labels

Labels = Simulink.Bus()
  index: int16[2]
  text: string[2]
  RGB: double[2]

Header = Simulink.Bus()
  key: Bus: key, DimensionsMode="Variable"
  dim: Bus: dim, DimensionsMode="Variable"
  hist: Bus: hist, DimensionsMode="Variable"
  nifti: Bus: nifti, DimensionsMode="Variable"

Histogram = Simulink.Bus()
  fncY: double, DimensionsMode="Variable"
  fncX: double, DimensionsMode="Variable"
  intensityMax: int16, DimensionsMode="Variable"
  cumulFncY: double, DimensionsMode="Variable"
  smoothFncX: double, DimensionsMode="Variable"
  smoothFncY: double, DimensionsMode="Variable"
  max: Bus: max, DimensionsMode="Variable"
  min: Bus: min, DimensionsMode="Variable"
  bgLevel: double, DimensionsMode="Variable"
  whiteLevel: double, DimensionsMode="Variable"

InitTransf = Simulink.Bus()
  Label: string, DimensionsMode="Variable"
  Matrix: double, DimensionsMode="Variable"

Mri = Simulink.Bus()
  FileName: string, DimensionsMode="Variable"
  Comment: string, DimensionsMode="Variable"
  Cube: int16, DimensionsMode="Variable"
  Voxsize: double, DimensionsMode="Variable"
  SCS: Bus: SCS, DimensionsMode="Variable"
  NCS: Bus: NCS, DimensionsMode="Variable"
  Header: Bus: Header, DimensionsMode="Variable"
  Histogram: Bus: Histogram, DimensionsMode="Variable"
  InitTransf: Bus: InitTransf, DimensionsMode="Variable"
  Labels: double, DimensionsMode="Variable"
  History: string, DimensionsMode="Variable"

NCS = Simulink.Bus()
  AC: double, DimensionsMode="Variable"
  PC: double, DimensionsMode="Variable"
  IH: double, DimensionsMode="Variable"
  R: double, DimensionsMode="Variable"
  T: double, DimensionsMode="Variable"
  Origin: double, DimensionsMode="Variable"

SCS = Simulink.Bus()
  NAS: double, DimensionsMode="Variable"
  LPA: double, DimensionsMode="Variable"
  RPA: double, DimensionsMode="Variable"
  R: double, DimensionsMode="Variable"
  T: double, DimensionsMode="Variable"
  Origin: double, DimensionsMode="Variable"

dim = Simulink.Bus()
  dim: double, DimensionsMode="Variable"
  vox_units: string, DimensionsMode="Variable"
  cal_units: string, DimensionsMode="Variable"
  unused1: double, DimensionsMode="Variable"
  datatype: double, DimensionsMode="Variable"
  bitpix: double, DimensionsMode="Variable"
  dim_un0: double, DimensionsMode="Variable"
  pixdim: double, DimensionsMode="Variable"
  vox_offset: double, DimensionsMode="Variable"
  funused1: double, DimensionsMode="Variable"
  funused2: double, DimensionsMode="Variable"
  funused3: double, DimensionsMode="Variable"
  cal_max: double, DimensionsMode="Variable"
  cal_min: double, DimensionsMode="Variable"
  compressed: double, DimensionsMode="Variable"
  verified: double, DimensionsMode="Variable"
  glmax: double, DimensionsMode="Variable"
  glmin: double, DimensionsMode="Variable"

hist = Simulink.Bus()
  descrip: string, DimensionsMode="Variable"
  aux_file: string, DimensionsMode="Variable"
  orient: double, DimensionsMode="Variable"
  originator: double, DimensionsMode="Variable"
  generated: string, DimensionsMode="Variable"
  scannum: string, DimensionsMode="Variable"
  patient_id: string, DimensionsMode="Variable"
  exp_date: string, DimensionsMode="Variable"
  exp_time: string, DimensionsMode="Variable"
  hist_un0: string, DimensionsMode="Variable"
  views: double, DimensionsMode="Variable"
  vols_added: double, DimensionsMode="Variable"
  start_field: double, DimensionsMode="Variable"
  field_skip: double, DimensionsMode="Variable"
  omax: double, DimensionsMode="Variable"
  omin: double, DimensionsMode="Variable"
  smax: double, DimensionsMode="Variable"
  smin: double, DimensionsMode="Variable"

key = Simulink.Bus()
  sizeof_hdr: double, DimensionsMode="Variable"
  data_type: string, DimensionsMode="Variable"
  db_name: string, DimensionsMode="Variable"
  extents: double, DimensionsMode="Variable"
  session_error: double, DimensionsMode="Variable"
  regular: string, DimensionsMode="Variable"
  hkey_un0: string, DimensionsMode="Variable"

max = Simulink.Bus()
  x: double, DimensionsMode="Variable"
  y: double, DimensionsMode="Variable"
  power: double, DimensionsMode="Variable"

min = Simulink.Bus()
  x: double, DimensionsMode="Variable"
  y: double, DimensionsMode="Variable"
  power: double, DimensionsMode="Variable"

nifti = Simulink.Bus()
  magic: double, DimensionsMode="Variable"
  dim_info: string, DimensionsMode="Variable"
  intent_p1: double, DimensionsMode="Variable"
  intent_p2: double, DimensionsMode="Variable"
  intent_p3: double, DimensionsMode="Variable"
  intent_code: double, DimensionsMode="Variable"
  slice_start: double, DimensionsMode="Variable"
  scl_slope: double, DimensionsMode="Variable"
  scl_inter: double, DimensionsMode="Variable"
  slice_end: double, DimensionsMode="Variable"
  slice_code: double, DimensionsMode="Variable"
  xyzt_units: double, DimensionsMode="Variable"
  slice_duration: double, DimensionsMode="Variable"
  toffset: double, DimensionsMode="Variable"
  qform_code: double, DimensionsMode="Variable"
  sform_code: double, DimensionsMode="Variable"
  quatern_b: double, DimensionsMode="Variable"
  quatern_c: double, DimensionsMode="Variable"
  quatern_d: double, DimensionsMode="Variable"
  qoffset_x: double, DimensionsMode="Variable"
  qoffset_y: double, DimensionsMode="Variable"
  qoffset_z: double, DimensionsMode="Variable"
  srow_x: double, DimensionsMode="Variable"
  srow_y: double, DimensionsMode="Variable"
  srow_z: double, DimensionsMode="Variable"
  intent_name: double, DimensionsMode="Variable"
  sform: double, DimensionsMode="Variable"
  qform: double, DimensionsMode="Variable"
  vox2ras: double, DimensionsMode="Variable"